# Grasshopper definition CWM.gh (Grasshopper 1.0.7)

cwm = CWMMain2()  # -> Integration, distances; inputs lines: list, cutOff: Int32, colors: list, r: Int32, run: Boolean
# ---------- cwm: Python ----------
"""
Calculates the integration of segments in an axial segment map.
-
Author: Eli Greenberg
-
    Args:
        lines: A set of lines comprising the axial segment map to be analyzed.
        cutOff: Integer. The number of lines in the analysis area.
        colors: A list of colors (strings) corresponding with the lines. These are used to indicate whether a line represents a staircase (or some otherwise less accessible path) or a regular path. This parameter is optional and is only used in the Physical analysis mode.
        r: Integer. The maximum length of shortest path to be considered in calculation. 0 means unlimited length.
        pointTolerance: A float representing a distance. Vertices of an axis that are closer to each other than this distance will be treated as intersecting.
        angTolerance: A float representing decimal degrees. Axes with angles between them that smaller than this number will be treated as continuous.
        baseCost: A float representing the basic cost of a turn.
        angleCost: A float representing the the multiplier for the angle value to calculate the angle cost componenet of the total cost.
        slopeCost: A float representing the the multiplier for the slope value to calculate the slope cost componenet of the total cost.
        stairColor: A string. The name of the color of lines that represent staircases or otherwise less accessible paths. This parameter is optional and is only used in the Physical analysis mode.
        stairCost: Float. A multiplier for both costs in case an axis represents a staircase. This parameter is optional (equal to 1 if not set).
        run: Boolean. Runs the component.
    Returns:
        Integration: A list of integration values.
        distances: A list of shortest path lengths.
"""

ghenv.Component.Name     = 'CWM Main 2'                                         # Define Component name
ghenv.Component.NickName = 'CWM'                                                # Define Component nickname
ghenv.Component.Message  = 'VER 1.0.2\nJun_10_2022'                             # Define Component message (Version and date)

import rhinoscriptsyntax as rs
import math

class Axis:
    
    def __init__(self, line):
        self.line = line
        self.intersects = []                                                    # a list for intersecting lines
        self.stepDepth = []                                                     # a list of shortest paths to all other lines
        self.vertices = []                                                      # a list for the vertices of the axial line
        self.vertices = rs.PolylineVertices(self.line)                          # determine the vertices of the axial line
        
    def detCostSlope(self, slopeCost):
        temp_point = rs.AddPoint(self.vertices[1].X, self.vertices[1].Y, self.vertices[0].Z) # create a point from one vertex with the z value of the other
        self.proj = rs.AddLine(self.vertices[0], temp_point)                    # create a horizontal line with the same x,y coordinates as self.line
        self.slope = min(rs.Angle2(self.line, self.proj))                       # calculate angle between the two lines
        self.costOffset = self.slope * slopeCost / 5.5
        
    def detType(self, color, stairCost):                                        # modify cost in case an axis represents stairs
        if color == stairColor:                                                 # if the axis color is the designated color of stairs
            self.stairCost = stairCost
        else:
            self.stairCost = 0
        
    def findIntersects(self, axialMap):                                         # determine which lines intersect with the axis in question 
        for segment in axialMap:
            if segment.line != self.line:                                       # ignore self-intersection
                for i in range (2):
                    for j in range(2):                                          # if any of the end-points are identical the lines intersect
                        similar = rs.PointCompare(self.vertices[i], segment.vertices[j], pointTolerance)
                        if similar == True:
                            self.intersects.append(segment.line)
            
    def pickCost(self, other):                                                  # Picks the right cost in an intersection along the shortest path                                                            
        smallAngle = min(rs.Angle2(self.line, other.line))                      # Picks the smaller angle of the two possible in an intersection
        proximity = 0
        if smallAngle == 0:                                                     # check if lines are continuous
            return other.stairCost                                              # only stair penalty applies, if relevant
        elif smallAngle <= angTolerance:                                        # check if the lines are practically continuous
            proximity = baseCost                                                # Base cost is negated
            angCost = 0                                                         # Angle cost is negated
        else:                                                                   # Otherwise, calculate the proper angle cost
            # angular component
            # the  cost of a turn depends on the incident angle. 
            if smallAngle < 90:                                                 # the angle of the turn is the difference between the imagined continuation of the axis and the other axis
                angCost = (smallAngle + 90) / 90
            elif smallAngle > 90:
                angCost = (smallAngle - 90) / 90
            else:
                angCost = smallAngle / 90                                       # right angles cost 1 and a reverse (can't happen in reality) costs 2
            angCost = angCost * angleCost
            
        # physical component
        for i in range(1):
            # checks if the next axis is ascending
            if rs.PointCompare(self.vertices[i], other.vertices[0], pointTolerance) and other.vertices[0].Z < other.vertices[1].Z:
                multiplier = -1  
            # checks if the next axis is ascending
            elif rs.PointCompare(self.vertices[i], other.vertices[1], pointTolerance) and other.vertices[1].Z < other.vertices[0].Z:
                multiplier = -1
            # the other case is a descending next axis
            else:
                multiplier = 1
        
        # calculate the compound cost of all components
        compoundCost = baseCost + angCost + (other.costOffset*multiplier) + other.stairCost - proximity
        # set a minimum value for the cost to avoid negative costs
        if compoundCost < 0.1:
            compoundCost = 0.1
        
        return compoundCost
    
    def minDistance(self, distances, spTree):
        min = float('inf')                                                      # initialize min value
        minIndex = mapSize + 1                                                  # set an out-of-range index
        for i in range(mapSize):                                                # check for unfinalized axes with set distances
            if self.spTree[i] == False and self.distances[i] <= min:
                min = self.distances[i]                                
                minIndex = i
        return minIndex
        
    def searchIntersects(self, other):                                          # checks if two lines intersect
        for i in range(len(self.intersects)):
            if other.line == self.intersects[i]:
                return True
        return False
        
    def findShortest(self):                                                     # must be run after axialMap is fully populated
        self.distances = []                                                     # list of all distances from Axis to all other axes
        self.spTree = []                                                        # list of lines included in shortest path tree, true if index is included

        for i in range(mapSize):
            self.distances.append(float('inf'))                                 # initialize all distances as infinite
            self.spTree.append(False)                                           # initialize all axes as not included
            if lines[i] == self.line:                                           # find the index of this axis in lines
                self.distances[i] = 0                                           # set the distance to self as 0
        # iterating through all axes
        for i in range(mapSize):
            u = self.minDistance(self.distances, self.spTree)                   # find the closest axis to the examined axis from the set not yet included in spTree
            self.spTree[u] = True                                               # add found axis to spTree
            
            # If axis is not included in spTree, intersects with the axis we examine and has a smaller aggregate cost to this instance of Axis, update the distance
            for j in range(mapSize):
                if self.spTree[j] == False and axialMap[u].searchIntersects(axialMap[j]) == True and self.distances[u] != float('inf') and self.distances[u] + axialMap[u].pickCost(axialMap[j]) < self.distances[j]:
                    self.distances[j] = self.distances[u] + axialMap[u].pickCost(axialMap[j])
                    
    def calcIntegration(self):                                                  # calculates integration of the axis
        self.n = 0                                                              # variable for number of axes, without continuous axes
        self.distSum = 0                                                        # variable for the sum of all shortest paths
        
        # define the number of axes without continuous axes and calculate the sums of all shortest paths
        if r > 0:                                                               # is there a radius value?
        
            for i in range(len(self.distances)):                                # case with radius
                #if self.distances[i] > 0 and self.distances[i] < r:
                if self.distances[i] <= r:
                    self.n = self.n + 1                                         # add the axis to the system
                    self.distSum = self.distSum + self.distances[i]             # add the shortest path to the sum
        else:
                                                
            for i in range(len(self.distances)):                                # case without radius
                #if self.distances[i] > 0:
                self.n = self.n + 1                                             # add the axis to the system
                self.distSum = self.distSum + self.distances[i]                 # add the shortest path to the sum
                    
        if self.distSum == 0:
            self.integration = 0
        else:
            self.integration = self.n / self.distSum                            # calculate integration


if run:
    
    axialMap = []                                                               # initialize a list for the axes
    Integration = []                                                            # initialize a list for calculated integration values
    mapSize = len(lines)
    
    for line in lines:                                                          # for every input line
        axialMap.append(Axis(line))                                             # create and instance of Axis
        
    for segment in axialMap:                                                    # for every segment in the axial map
        segment.findIntersects(axialMap)                                        # find the segments with which it intersects
        segment.detCostSlope(slopeCost)                                         # calculate the slope cost of the segemnt
        
    for i in range(mapSize):                                                    # determine if the segment represents stairs
        axialMap[i].detType(colors[i], stairCost)                               # and set the stair cost accordingly
    
    for i in range(cutOff):                
        axialMap[i].findShortest()                                              # create a shortest path graph for each axis 
        axialMap[i].calcIntegration()                                           # calculate the integration value of each axis
        print "n = ", axialMap[i].n                                             # tests for debugging purposes
        print "distSum = ", axialMap[i].distSum                                 # tests for debugging purposes
        Integration.append(axialMap[i].integration)                             # create a list of integration values for the entire system

# tests for debugging purposes
    print axialMap[0].spTree
    print axialMap[0].integration
    distances = axialMap[0].distances
# ---------- end cwm ----------
