# Grasshopper definition PEM.gh (Grasshopper 1.0.7)

pem = PEMMain()  # -> Integration, distances; inputs lines: list, colors: list
# ---------- pem: Python ----------
"""
Calculates the integration of axes in an axial map.
-
Author: Eli Greenberg
-
    Args:
        lines: A set of lines comprising the axial map to be analyzed.
        colors: A list of colors (strings) corresponding with the lines. These are used to indicate whether a line represents a staircase (or some otherwise less accessible path) or a regular path. This parameter is optional and is only used in the Physical analysis mode.
        r: Integer. The maximum length of shortest path to be considered in calculation. 0 means unlimited length.
        pointTolerance: A float representing a distance. Vertices of an axis that are closer to each other than this distance will be treated as intersecting.
        angTolerance: A float representing decimal degrees. Axes with angles between them that smaller than this number will be treated as continuous.
        Mode: Select one of three principles for the analysis to be done by: Topological, Angular or Physical.
        stairColor: A string. The name of the color of lines that represent staircases or otherwise less accessible paths. This parameter is optional and is only used in the Physical analysis mode.
        stairPenalty: Float. A value which will be added to both costs in case an axis represents a staircase. This parameter is optional and is only used on the Physical analysis mode.
        run: Boolean. Runs the component.
    Returns:
        Integration: A list of integration values.
        distances: A list of shortest path lengths.
"""

ghenv.Component.Name     = 'PEM Main'                                           # Define Component name
ghenv.Component.NickName = 'PEM'                                                # Define Component nickname
ghenv.Component.Message  = 'VER 0.1.0\nOct_02_2018'                             # Define Component message (Version and date)

import rhinoscriptsyntax as rs
import math

class Axis:
    
    def __init__(self, line, costUp = 1, costDown = 1):
        self.line = line
        self.intersects = []                                                    # a list for intersecting lines
        self.stepDepth = []                                                     # a list of shortest paths to all other lines
        self.vertices = []                                                      # a list for the vertices of the axial line
        self.vertices = rs.PolylineVertices(self.line)                          # determine the vertices of the axial line
        
    def detCost(self):
        self.angle = rs.Angle(self.vertices[0], self.vertices[1])               # calculate angle
        self.tmpExp = math.sqrt(math.pow(self.angle[2], 2) + math.pow(self.angle[3],2))
        self.tanG = abs(self.angle[4] / self.tmpExp)                            # calculate the tan of the angle                                   
        self.vPower = -3.5 * self.tanG                                          # Tobler's formula
        self.v = 6 * math.exp(self.vPower)                                      # Tobler's formula with the result turned from km/hr into m/sec
        self.p = 1.5 * pow(self.v, 2) +  0.35 * self.tanG * self.v              # calculate the power
        self.costOffset = 1 / self.p
        return self.costOffset

    def findCosts(self):                                                        # determines the costs of moving in either direction along the line
        self.costUp = 1 + self.costOffset                                       # cost of moving uphill is more than 1
        self.costDown = 1 - self.costOffset                                     # cost of moving downhill is less than 1
        
    def detType(self, color):                                              # modify cost in case axis represents stairs
        if color == stairColor:                                                 # if the axis color is the designated color of stairs
            self.costUp = self.costUp + stairPenalty                            # apply penalty to both costs
            self.costDown = self.costDown + stairPenalty
        
    def findIntersects(self, axialMap):                                         # determine which lines intersect with the axis in question 
        for i in range(mapSize):
            if axialMap[i].line != self.line:                                   # ignore self-intersection
                for j in range (2):
                    for k in range(2):
                        similar = rs.PointCompare(self.vertices[j], axialMap[i].vertices[k], pointTolerance)
                        if similar == True:
                            self.intersects.append(lines[i])
                #if self.vertices[0] == axialMap[i].vertices[0] or self.vertices[0] == axialMap[i].vertices[1] or self.vertices[1] == axialMap[i].vertices[0] or self.vertices[1] == axialMap[i].vertices[1]:
                    #self.intersects.append(lines[i])
            """
                self.inPoints = rs.LineLineIntersection(self.line, lines[i])
                # avoid finding theoretical points
                if self.inPoints != None and rs.IsPointOnCurve(self.line, self.inPoints[0]) and rs.IsPointOnCurve(lines[i], self.inPoints[1]):
                    self.intersects.append(lines[i])                            # made this way so it can be added upon initialization
            """
    def pickCost(self, other):                                                  # Picks the right cost in an intersection along the shortest path                                                            
        smallAngle = min(rs.Angle2(self.line, other.line))                      # Picks the smaller angle of the two possible in an intersection
        if smallAngle <= angTolerance:                                          # check if lines are continuous, according to the tolerance value
            return 0                                                            # If so no cost is incurred
        else:                                                                   # Otherwise, calculate the proper cost acording to the case
            # in case of physical mode
            if Mode == 'Physical':
                for i in range(1):
                    # checks if the next axis is ascending
                    if rs.PointCompare(self.vertices[i], other.vertices[0], pointTolerance) and other.vertices[0].Z < other.vertices[1].Z:
                        return other.costDown  
                    # checks if the next axis is ascending
                    elif rs.PointCompare(self.vertices[i], other.vertices[1], pointTolerance) and other.vertices[1].Z < other.vertices[0].Z:
                        return other.costDown
                    # the other case is a descending next axis
                    else:
                        return other.costUp
                        
            # in case of topological mode
            elif Mode == 'Topological':                                         # cost of all turns is 1 in this case
                return 1
        
            # in case of angular mode
            elif Mode == 'Angular':                                             # the  cost of a turn depends on the incident angle. 
                if smallAngle < 90:                                             # the angle of the turn is the difference between the imagined continuation of the axis and the other axis
                    angCost = (smallAngle + 90) / 90
                elif smallAngle > 90:
                    angCost = (smallAngle - 90) / 90
                else:
                    angCost = smallAngle / 90                                   # right angles cost 1 and a reverse (can't happen in reality) costs 2
                return angCost
    
    def minDistance(self, distances, spTree):
        min = float('inf')                                                      # initialize min value
        minIndex = mapSize + 1                                                  # set an out-of-range index
        for i in range(mapSize):                                                # check for unfinalized axes with set distances
            if self.spTree[i] == False and self.distances[i] <= min:
                min = self.distances[i]                                
                minIndex = i
        return minIndex
        
    def searchIntersects(self, other):                                          # checks if two lines intersect
        for i in range(len(self.intersects)):
            if other.line == self.intersects[i]:
                return True
        return False
        
        
    def findShortest(self):                                                     # must be run after axialMap is fully populated
        self.distances = []                                                     # list of all distances from Axis to all other axes
        self.spTree = []                                                        # list of lines included in shortest path tree, true if index is included

        for i in range(mapSize):
            a = float('inf')
            b = False
            self.distances.append(a)                                            # initialize all distances as infinite
            self.spTree.append(b)                                               # initialize all axes as not included
            if lines[i] == self.line:                                           # find the index of this axis in lines
                self.distances[i] = 0                                           # set the distance to self as 0
        # iterating through all axes
        for i in range(mapSize):
            u = self.minDistance(self.distances, self.spTree)                   # find the closest axis to the examined axis from the set not yet included in spTree
            self.spTree[u] = True                                               # add found axis to spTree
            
            # If axis is not included in spTree, intersects with the axis we examine and has a smaller aggregate cost to this instance of Axis, update the distance
            for j in range(mapSize):
                if self.spTree[j] == False and axialMap[u].searchIntersects(axialMap[j]) == True and self.distances[u] != float('inf') and self.distances[u] + axialMap[u].pickCost(axialMap[j]) < self.distances[j]:
                    self.distances[j] = self.distances[u] + axialMap[u].pickCost(axialMap[j])
                    
    def calcIntegration(self):                                                  # calculates integration of the axis
        self.n = 0                                                              # variable for number of axes, without continuous axes
        self.distSum = 0                                                        # variable for the sum of all shortest paths
        
        # define the number of axes without continuous axes and calculate the sums of all shortest paths
        if r > 0:                                                               # is there a radius value?
        
            for i in range(len(self.distances)):                                # case with radius
                #if self.distances[i] > 0 and self.distances[i] < r:
                if self.distances[i] <= r:
                    self.n = self.n + 1                                         # add the axis to the system
                    self.distSum = self.distSum + self.distances[i]             # add the shortest path to the sum
        else:
                                                
            for i in range(len(self.distances)):                                # case without radius
                #if self.distances[i] > 0:
                self.n = self.n + 1                                             # add the axis to the system
                self.distSum = self.distSum + self.distances[i]                 # add the shortest path to the sum
                    
        if self.distSum == 0:
            self.integration = 0
        else:
            self.integration = self.n / self.distSum                            # calculate integration
"""
slope = 45
slope2 = 30
rad_ang = math.radians(slope)
tanG = abs(math.tan(rad_ang))
vPower = -3.5 * tanG                                          # Tobler's formula
v = 6 * math.exp(vPower)                                      # Tobler's formula with the result turned from km/hr into m/sec
p = 1.5 * pow(v, 2) +  0.35 * tanG * v                        # calculate the power
costOffset = 1 / p

rad_ang2 = math.radians(slope2)
tanG2 = abs(math.tan(rad_ang2))
vPower2 = -3.5 * tanG2                                        # Tobler's formula
v2 = 6 * math.exp(vPower2)                                    # Tobler's formula with the result turned from km/hr into m/sec
p2 = 1.5 * pow(v2, 2) +  0.35 * tanG2 * v2                    # calculate the power
costOffset2 = 1 / p2
print costOffset
print costOffset2

#45max = 0.1
#30max = 1
"""

if run:
    
    axialMap = []
    Integration = []
    mapSize = len(lines)
    
    for i in range(mapSize):                                                    # for every input line
        axialMap.append(Axis(lines[i]))                                         # create and instance of Axis
        
    for i in range(mapSize):                                                    # for every input line
        axialMap[i].findIntersects(axialMap)                                    # find the lines with which it intersects
        
    if Mode == 'Physical':
        for i in range(mapSize):
            axialMap[i].detCost()                                               # determine the costOffset for each axis
            axialMap[i].findCosts()                                             # determine the costUp and costDown
        if colors and stairColor and stairPenalty:
            for j in range(mapSize):
                axialMap[j].detType(colors[j])
            
            
    for i in range(mapSize):                
        axialMap[i].findShortest()                                              # create a shortest path graph for each axis
        axialMap[i].calcIntegration()                                           # calculate the integration value of each axis
        print "n = ", axialMap[i].n                                             # tests for debugging purposes
        print "distSum = ", axialMap[i].distSum                                 # tests for debugging purposes
        Integration.append(axialMap[i].integration)                             # create a list of integration values for the entire system

# tests for debugging purposes
    print axialMap[0].spTree
    print axialMap[0].integration
    distances = axialMap[0].distances
# ---------- end pem ----------
