# Grasshopper definition PEM_Visibility.gh (Grasshopper 1.0.7)

pemvis = PEMVisibility()  # -> out, newAxes, newAxesBuffer, newStairs, newStairsBuffer; inputs axes: list, axesBuffer: list, stairs: list, stairsBuffer: list
# ---------- pemvis: Python ----------
"""
Projects an axial map on a topological model and redraws it according to actual visibility.
-
Author: Eli Greenberg
-
    Args:
        axes: A list of lines comprising the segment map to be modified.
        axesBuffer: A list of lines comprising the buffer area for the analysis.
        stairs: A list of lines in the segment map that represent staircases.
        stairsBuffer: A list of lines representing staircases in the buffer area for the analysis.
        projectionVec: The vector along which to project the lines onto the topography.
        topo: A model of the topography as a mesh.(surface and brep possible in the future)
        resolution: Float. The shortest possible segment in meters.
        eyeHeight: Float. The human eye height to test for bumps against, in meters.
        run: Boolean. Runs the component.
    Returns:
        newAxes: A list of 3D segments in the test area.
        newAxesBuffer: A list of 3D segments in the buffer area.
        newStairs: A list of 3D segments in the test area that represent staircases.
        newStairsBuffer: A list of 3D segments in the buffer area that represent staircases.
"""

ghenv.Component.Name     = 'PEM Visibility'                                     # Define Component name
ghenv.Component.NickName = 'PEMVis'                                             # Define Component nickname
ghenv.Component.Message  = 'VER 0.0.2\nMar_11_2019'                             # Define Component message (Version and date)

import rhinoscriptsyntax as rs

def topoProjAxes(lines, topMesh, res = 5, eyeH = 1.5, proVec = (0,0,1)):                                # function for redrawing lines according to topography
                                                                                                        # params: list of lines, topography mesh, resolution of line division, eye height, projection vector
    listLen = len(lines)                                                                                # determine number of lines in input list
    newLines = []
    for i in xrange(listLen):                                                                           # for every line in list
        if rs.IsLine(lines[i]):                                                                         # check if it is indeed a line
        
            points = rs.DivideCurveLength(lines[i], res, True, True)                                    # divide the line every 'res' units, save points as list
            points.append(rs.CurveEndPoint(lines[i]))
            projPoints = []
            print 'no. of points is' , len(points)
            for k in range(len(points)):
                projPoint = rs.ProjectPointToMesh(points[k], topMesh, proVec)                           # project list of points unto topography mesh
                projPoint = list(projPoint)                                                             # turn output into list
                projPoints.append(projPoint[0])                                                         
            print 'no. of projPoints is' , len(projPoints)
            cleanPoints = []                                                                            # create new list for retained points
            cleanPoints.append(projPoints[0])                                                           # retain first point of original line
            for j in range(1, len(projPoints)-1):                                                       # for every point, except the first and the last
                if (projPoints[j].Z > projPoints[j-1].Z) and (projPoints[j].Z > projPoints[j+1].Z):     # if point is higher than both
                    cleanPoints.append(projPoints[j])                                                   # retain point for later use
                elif (projPoints[j].Z > projPoints[j-1].Z) and (projPoints[j].Z == projPoints[j+1].Z):  # if point is higher than 1 and equal to the other
                    cleanPoints.append(projPoints[j])                                                   # retain point for later use
                elif (projPoints[j].Z == projPoints[j-1].Z) and (projPoints[j].Z > projPoints[j+1].Z):  # if point is equal to 1 and higher than the other
                    cleanPoints.append(projPoints[j])                                                   # retain point for later use
            cleanPoints.append(projPoints[-1])                                                          # retain last point of original line
            print 'no. of cleanPoints is' , len(cleanPoints)
            newPoints = []                                                                              # create list cleanPoints
            if len(cleanPoints) > 2:                                                                    # if the list contains more than 2 points
                for l in range(1, len(cleanPoints)-1):                                                  # iterate over all points except  first and last
                    poplist = []                                                                        # list of points to remove
                    beforePoint = rs.AddPoint((cleanPoints[l-1].X), (cleanPoints[l-1].Y), ((cleanPoints[l-1].Z) + eyeH))    # create point at eyeH above the previous point
                    beforeLine = rs.AddLine(beforePoint, cleanPoints[l+1])                                                  # draw line between that elevated point and the next point
                    afterPoint = rs.AddPoint((cleanPoints[l+1].X), (cleanPoints[l+1].Y), ((cleanPoints[l+1].Z) + eyeH))     # create point at eyeH above the next point
                    afterLine = rs.AddLine(afterPoint, cleanPoints[l-1])                                                    # draw line between that elevated point and the previous point
                    solut1 = rs.CurveMeshIntersection(beforeLine, topMesh, False)                                           # check if the line intersects with topography mesh
                    solut2 = rs.CurveMeshIntersection(afterLine, topMesh, False)                                            # check if the line intersects with topography mesh
                    if solut1 and len(solut1) > 1:                                                                          # if the line intersects with topography mesh
                        poplist.append(l)                                                                                   # add the cleanPoint  index to the removal list
                    elif solut2 and len(solut2) > 1:                                                                        # if the line intersects with topography mesh
                        poplist.append(l)                                                                                   # add the cleanPoint index to the removal list
                    print poplist
                for m in xrange(len(cleanPoints)):                                                                          # for every point in list
                    if m not in poplist:                                                                                    # if the index is not in removal list
                        newPoints.append(cleanPoints[m])                                                                    # add to newPoints list
            else:
                newPoints.extend(cleanPoints)
            print 'newPoints length is' , len(newPoints)
            if len(newPoints) > 2:
                polyline = rs.AddPolyline(newPoints)
            else:
                polyline = rs.AddLine(newPoints[0], newPoints[1])
                
            if rs.IsPolyline(polyline):
                newLines.extend(rs.ExplodeCurves(polyline))
            else:
                newLines.append(polyline)
        else:
            print 'Some of the axes are not lines!'                                                 # if an element in input list is not a line print a warning and exit
            return None
    return newLines                                                                                 # return list of new 3d lines
    
def topoProjStairs(lines, topMesh, proVec = (0,0,1)):                                               # function for redrawing lines that represent stiars acording ot topography
                                                                                                    # params: list of lines, topography mesh, projection vector
    listLen = len(lines)                                                                            # determine number of lines in input list
    newLines = []
    for i in xrange(listLen):                                                                       # for every line
        if rs.IsLine(lines[i]):                                                                     # check if it is a line (and not another type)
            start = rs.CurveStartPoint(lines[i])                                                    # extract start point of line
            end = rs.CurveEndPoint(lines[i])                                                        # extract end point of line
            newStart = list(rs.ProjectPointToMesh(start, topMesh, proVec))                          # project start point onto topography mesh
            newEnd = list(rs.ProjectPointToMesh(end, topMesh, proVec))                              # project end point onto topography mesh
            newLine = rs.AddLine(newStart[0], newEnd[0])                                            # draw a new line between the projected points
            newLines.append(newLine)                                                                # add new line to list of stairs
        else:                                                                                       # if an element in input list is not a line print a warning and exit
            print 'Some of the axes are not lines!'
            return None
    return newLines                                                                                 # return new list of 3d lines that represent stairs

if run:                                                                                             # activate
    
    newAxes = topoProjAxes(axes, topo, resolution, eyeHeight, projectionVec)                        # redraw axes
    newAxesBuffer = topoProjAxes(axesBuffer, topo, resolution, eyeHeight, projectionVec)            # redraw buffer axes
    newStairs = topoProjStairs(stairs, topo, projectionVec)                                         # redraw stairs
    newStairsBuffer = topoProjStairs(stairsBuffer, topo, projectionVec)                             # redraw buffer stairs
# ---------- end pemvis ----------
