# Grasshopper definition Weight_Analyzer.gh (Grasshopper 1.0.7)

wanalyzer = WeightAnalyzer()  # -> out, rel_weights_1, values_1, rel_weights_2, values_2, rel_weights_3, values_3, seg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; inputs context: list, starting_pt: Point3d, normalized: Boolean, run: Boolean
# ---------- wanalyzer: Python ----------
"""
Calculates the relative importance of weight categories in decision making along a path in a graph.
-
Author: Eli Greenberg
-
    Args:
        path: A polyline describing the path to be analyzed.
        context: A list of lines comprising the area around the path. The graph in which the path is embedded.
        starting_pt: A point. The starting point of the path.
        normalized: Boolean. Indicates whether the analysis will be normalized according to the number of choices in each decision point along the path. False by default.
        run: Boolean. Runs the component.
    Returns:
        out: Testing phase generic output.
        rel_weights_1: A tree of weights for category 1.
        values_1: A tree of non-normalized values for category 1.
        rel_weights_2: A tree of weights for category 2.
        values_2: A tree of non-normalized values for category 2.
        rel_weights_3: A tree of weights for category 3.
        values_3: A tree of non-normalized values for category 3.
"""

ghenv.Component.Name     = 'Weight Analyzer'                                    # Define Component name
ghenv.Component.NickName = 'WAnalyzer'                                          # Define Component nickname
ghenv.Component.Message  = 'VER 0.0.6\nMay_29_2020'                             # Define Component message (Version and date)

import rhinoscriptsyntax as rs
import math
import clr
clr.AddReference('Grasshopper')
from Grasshopper.Kernel.Data import GH_Path
from Grasshopper import DataTree
import System

class Path:
    ###
    def __init__(self, path, context):                                          # path instance builder
        
        self.context = context                                                  # read context variable
        self.start = rs.CurveStartPoint(path)                                   # set strarting point as the first point in the path polyline
        self.end = rs.CurveEndPoint(path)                                       # set strarting point as the last point in the path polyline
        self.segments = rs.ExplodeCurves(path)                                  # explode path polyline into line segments
        self.points = rs.PolylineVertices(path)                                 # extract vertices from path polyline (decision points)
        self.weights_1 = []                                                     # six lists for weights
        self.weights_2 = []
        self.weights_3 = []
        self.values_1 = []
        self.values_2 = []
        self.values_3 = []
    ###
    def direction_fixer(self, starting_pt):                                     # function to avoid a path in the wrong direction
        
        if rs.PointCompare(starting_pt, self.start):                            # verify path direction
            return self
            
        else:                                                                   
            self.points.reverse()                                               # reverse path if direction is wrong
            self.end = self.points[-1]                                          # the end point is set again
            self.segments.reverse()                                             # MAY BE REDUNDANT
            return self

    def order(self ,weight_type):
        
        values = []
        weights = []                                                            # output variable
        print 'wt', weight_type
        for m in range(len(self.choice_points)):                                # for every decision point
            print 'm', m
            temp_values = []
            temp_weights = []
            
            # angle
            if weight_type == 1:
                for n in range(len(self.choices[m])):                           # for every potential choice at that decision point
                    """
                    if rs.PointCompare(self.choice_points[m], rs.CurveEndPoint(self.choices[m][n])):
                        point_2 = rs.CurveStartPoint(self.choices[m][n])
                    else:
                        point_2 = rs.CurveEndPoint(self.choices[m][n])
                    
                    angle = abs(rs.Angle(self.choice_points[m], point_2, True)[0])   # calculate relevant angle
                    """
                    angle = max(rs.Angle2(self.choice_segs[m], self.choices[m][n])) - 180
                    temp_values.append(angle)
                    print 'len tv', len(temp_values)
                # combined = sum(temp_values)                                     # calculate sums of angles of all choices at that point
                for p in range(len(temp_values)):                               # for every potential choice at that decision point
                    # weight = temp_values[p] / combined
                    weight = temp_values[p] / 360
                    print 'w', weight
                    temp_weights.append(weight)
                values.append(temp_values)
                weights.append(temp_weights)
                print 'len v', len(values)
                print 'len w', len(weights)
                print values[m]
                
            # slope
            if weight_type == 2:
                for n in range(len(self.choices[m])):
                    if rs.PointCompare(self.choice_points[m], rs.CurveEndPoint(self.choices[m][n])):
                        point_2 = rs.CurveStartPoint(self.choices[m][n])
                    else:
                        point_2 = rs.CurveEndPoint(self.choices[m][n])
                    
                    elevation = rs.Angle(self.choice_points[m], point_2, True)[4]   # calculate relevant angle
                    distance = rs.Distance(self.choice_points[m], point_2)          # calculate length
                    asin = math.asin((elevation / distance))
                    temp_values.append(math.degrees(asin))
                    
                combined = sum(temp_values)                                     # calculate sums of slopes of all choices at that point
                for p in range(len(temp_values)):
                    if combined != 0:
                        weight = temp_values[p] / combined
                    else:
                        weight = 0
                    temp_weights.append(weight)
                values.append(temp_values)
                weights.append(temp_weights)
            
            # metric distance
            if weight_type == 3:
                for n in range(len(self.choices[m])):
                    if rs.PointCompare(self.choice_points[m], rs.CurveEndPoint(self.choices[m][n])):
                        point_2 = rs.CurveStartPoint(self.choices[m][n])
                    else:
                        point_2 = rs.CurveEndPoint(self.choices[m][n])
                    distance = rs.Distance(point_2, self.end)                   # calculate metric distance weight
                    temp_values.append(distance)
                
                combined = sum(temp_values)                                  # calculate sums of distances of all choices at that point
                for p in range(len(temp_values)):
                    weight = temp_values[p] / combined
                    temp_weights.append(weight)
                values.append(temp_values)
                weights.append(temp_weights)
                
        return values, weights
    ###
    def analyze(self):                                                          # main function
        
        weights_1 = []
        weights_2 = []
        weights_3 = []
        values_1 = []
        values_2 = []
        values_3 = []
        # Create local context of possible intersections
        # and alculate local choices for every decision point.
        self.choice_points = []                                                 # list of choice points
        self.choices = []                                                       # list of lists of possible choices at every choice point
        self.choice_segs = []                                                   # list of choice segments
        for i in range(1, len(self.points)-1):                                  # for every point
            choices = []                                                        # create temporary list of possible choices
            for con in self.context:                                            # for every segment in the context
                # check if the point is on the segment
                if rs.PointCompare(rs.CurveStartPoint(con), self.points[i], 1):
                    choices.append(con)                                         # if yes, add segemnt to choices
                elif rs.PointCompare(rs.CurveEndPoint(con),self.points[i], 1):
                    choices.append(con)                                         # if yes, add segemnt to choices
                
                if len(choices) > 0:
                    if rs.IsPointOnCurve(self.segments[(i-1)], rs.CurveEndPoint(choices[-1])) and rs.IsPointOnCurve(self.segments[(i-1)],rs.CurveStartPoint(choices[-1])):
                        choices.remove(con)                                     # if the segment overlaps with the segment we came from (back-tracking), remove it.
            print 'len ch', len(choices)
            if len(choices) > 1:                                                # if there is an actual choice at the point
                self.choices.append(choices)                                    # add the choices to the choices attribute
                self.choice_points.append(self.points[i])                       # add the point to the choice points attribute
                self.choice_segs.append(self.segments[i-1])
                print 'len self ch', len(self.choices)
                print 'len self ch pt', len(self.choice_points)
        # actual analysis
        for k in range(1,4):                                                    # for each weight type (1,2,3)
            values, weights = self.order(k)                                     # determine all weight types
            if k == 1:                                                          # ANGLE
                weights_1.append(weights)
                values_1.append(values)
            if k == 2:                                                          # SLOPE
                weights_2.append(weights)
                values_2.append(values)
            if k == 3:                                                          # DISTANCE
                weights_3.append(weights)
                values_3.append(values)
                    
        
        return weights_1, values_1, weights_2, values_2, weights_3, values_3
        
def make_tree(input):                                                           # turn list of lists into a tree
    
    tree = DataTree[System.Object]()                                            # declare tree)
    """
    for i, branch in enumerate(input):
        for address, number in enumerate(branch):
            path = GH_Path(i, address)
            tree.Add(number, path)
    """
    for address, branch in enumerate(input):
        path = GH_Path(address)
        tree.Add(branch, path)
            
    return tree

def flatten(input):
    flat_list = []
    for list in input:
        for item in list:
            flat_list.append(item)
    return flat_list
    
if run:
    analyzed_path = Path(path, context)                                         # read inputs
    analyzed_path = analyzed_path.direction_fixer(starting_pt)                  # check direction and reverse path if needed
    # output variables
    rw_1, v_1, rw_2, v_2, rw_3, v_3 = analyzed_path.analyze()                                     # analyze path
    
    # tests
    seg = analyzed_path.segments
    pts = analyzed_path.points
    c_pts = analyzed_path.choice_points
    c_segs =  analyzed_path.choices[3][0]
    print 'seg', len(seg)
    print 'pts', len(pts)
    print 'c_pts', len(c_pts)
    print 'choices', len(analyzed_path.choices)
    counter = 0
    for ch in analyzed_path.choices:
        print counter, len(ch)
        counter +=1
    print values_1
    print rel_weights_1
    print 'rw1', len(rw_1)
    print 'branch',len(rw_1[0])
    print 'address',len(rw_1[0][0])
    print 'rw1', type(rw_1)
    print 'branch',type(rw_1[0])
    print 'address',type(rw_1[0][0])
    print 'address',rw_1[0][0][0]
    print 'address',type(rw_1[0][0][0])
    
    # make trees
    rel_weights_1 = make_tree(rw_1[0])
    values_1 = make_tree(v_1[0])
    rel_weights_2 = make_tree(rw_2[0])
    values_2 = make_tree(v_2[0])
    rel_weights_3 = make_tree(rw_3[0])
    values_3 = make_tree(v_3[0])
    
    angle_vals = flatten(v_1[0])
    angle_wgts =  flatten(rw_1[0])
    slope_vals = flatten(v_2[0])
    slope_wgts = flatten(rw_2[0])
    dist_vals = flatten(v_3[0])
    dist_wgts = flatten(rw_3[0])
    
    choices = make_tree(analyzed_path.choices)
# ---------- end wanalyzer ----------
